# Grasshopper definition Elk_OSM.gh (Grasshopper 1.0.7)
# plug-ins: ElkGHComponents

panel = Panel("D:\Work\StudentWork\Co-Lab\00-ProjectDetails\Site\OSM\map.osm")
path = FilePath(panel)
loc = Location(FilePathText=path)  # -> OSMPointData, OSMFile, LongitudeDomain, LatitudeDomain
osm = OSMData(
    OSMPointData=loc.OSMPointData,
    OSMFilePath=path,
    Feature="route",
    Generate3d=False,
    IndividualOutputs=False,
    SelectedTypes=["bicycle", "bus", "canoe", "detour", "ferry", "hiking", "horse", "inline_skates", "light_rail", "mtb", "nordic_walking", "pipeline", "piste", "power", "railway", "road", "running", "ski", "train", "tram"])  # -> Ways, FeatureKey
osm_2 = OSMData(OSMPointData=loc.OSMPointData, OSMFilePath=path, Feature="building", Generate3d=True, IndividualOutputs=False)  # -> Ways, Buildings, FeatureKey
osm_3 = OSMData(OSMPointData=loc.OSMPointData, OSMFilePath=path, Feature="route", Generate3d=False, IndividualOutputs=False)  # -> Ways, FeatureKey
pline = PolyLine(Vertices=osm.Ways, Closed=False)
